# Grasshopper definition 01_BlueCFD_Air_Modelling.gh (Grasshopper 1.0.7)

windows = Surface([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])
room = Brep([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])
door = Brep([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])
inlets = Surface(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)
sources = Surface(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)
outlets = Surface(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)
bcamodel = ABBCAModel(
    room_blocks=flatten(room),
    door_blocks=flatten(door),
    windows=flatten(windows),
    inlets=flatten(inlets),
    outlets=flatten(outlets),
    sources=flatten(sources))  # -> out, blue_model, stl_file; inputs room_blocks: list of Brep, door_blocks: list of Brep, windows: list of Surface, inlets: list of Surface, outlets: list of Surface, sources: list of Surface
# ---------- bcamodel: Python ----------
# Description
ghenv.Component.Name = "AB BCA Model"
ghenv.Component.NickName = 'BCAModel'
ghenv.Component.Message = '0.1.0'
ghenv.Component.Category = 'Ant blueCFD'
ghenv.Component.SubCategory = '2 :: CFD'

try:
#    from ant_tools import config
    from ant_blueCFD import model
except ImportError as e:
    raise ImportError('\nFailed to import Ant blueCFD:\n\t{}'.format(e))


import ghpythonlib.components as gh

reload(model)

if room_blocks:
    blue_model=model.brep_to_blueModel(room_blocks,door_blocks, _windows = _windows,
         _inlets = _inlets, _outlets = _outlets, _sources= _sources)
if blue_model:
    stl_file= model.blueModel_to_stl(blue_model,file_name = file_name, path = folder)
# ---------- end bcamodel ----------
bcavisualize = ABBlueCFDAIRVisualize(blue_model=flatten(bcamodel.blue_model))  # -> out, walls, roofs, floors, connects, windows, inlets, outlets, sources, wire_frame
# ---------- bcavisualize: Python ----------
# Description
ghenv.Component.Name = "AB blueCFD AIR visualize"
ghenv.Component.NickName = 'BCAVisualize'
ghenv.Component.Message = '0.1.0'
ghenv.Component.Category = 'Ant blueCFD'
ghenv.Component.SubCategory = ''

#from ghpythonlib.componentbase import executingcomponent as component
import Rhino as rc
from System.Drawing import Color
import Rhino.Geometry as rg
import rhinoscriptsyntax as rs
import scriptcontext as sc
import ghpythonlib.components as gh

wall =[]
connect =[]
roofs =[]
windows =[]
inlets=[]
outlets=[]
sources=[]
floors =[]
wire_frame=[]
if blue_model:
    rooms = blue_model.rooms
    doors = blue_model.doors
    breps = [i.geometry for i in rooms]
    for geo in breps:
        wire_frame += gh.BrepWireframe(geo,"-1")

    for room in rooms:
        wall+=room.wall
        roofs += room.roof
        windows += room.windows
        inlets +=room.inlets
        outlets += room.outlets
        sources +=room.sources
        floors += room.floor
    for door in doors:
    
        connect+=door.connect

    openings=[]

    if wall and connect:
        walls = wall + connect
    elif wall:
        walls = wall
    
    for geo in walls:
        geo.VertexColors.CreateMonotoneMesh(rs.CreateColor(125, 125, 125,200))
        
    for geo in roofs:
        geo.VertexColors.CreateMonotoneMesh(rs.CreateColor(155, 20, 20,0))
    for geo in floors:
        geo.VertexColors.CreateMonotoneMesh(rs.CreateColor(185, 145, 28,0))
    if inlets:
        for geo in inlets:
            geo.VertexColors.CreateMonotoneMesh(rs.CreateColor(200, 128, 255,130))
            openings.append(geo)
    if outlets:
        for geo in outlets:
            geo.VertexColors.CreateMonotoneMesh(rs.CreateColor(200, 123, 80,130))
            openings.append(geo)
    
    if windows:
        for geo in windows:
            geo.VertexColors.CreateMonotoneMesh(rs.CreateColor(0, 200, 255,130))
            openings.append(geo)
    
    if sources:
        for geo in sources:
            geo.VertexColors.CreateMonotoneMesh(Color.Red)
            openings.append(geo)
# ---------- end bcavisualize ----------
bluecfd_air = ABRunBlueCFDAIR(stl_file=bcamodel.stl_file, open=Button())  # -> blueCFDAIR; inputs open: Boolean
# ---------- bluecfd_air: Python ----------
# Description
ghenv.Component.Name = "AB run blueCFD AIR"
ghenv.Component.NickName = 'blueCFD AIR'
ghenv.Component.Message = '0.1.0'
ghenv.Component.Category = 'Ant blueCFD'
ghenv.Component.SubCategory = ''

import os
import ghpythonlib.components as ghcomp
import subprocess
import fnmatch

from ant_blueCFD.utility import get_common_program_files, find_BCA_exe_file


if blueCFDAIR_exe_path:
    path = blueCFDAIR_exe_path
else:
    path= find_BCA_exe_file()

if stl_file is not None:
    stl_file = stl_file.replace(r"\\","/")
    path = path.replace("\\","/")
    if open:
        subprocess.call([path , stl_file])

    work_dir = os.path.abspath(os.path.join(stl_file,".."))
    blueCFDAIR =[]
    for  file in os.listdir(work_dir):
    
        if "blueCFDAIR" in file and "tmp" not in file:
            blueCFDAIR.append(os.path.join(work_dir,file))
# ---------- end bluecfd_air ----------
panel = Panel(bcamodel.stl_file)
unzip_bluecfd_air = ABUnzipBlueCFDAIR(blueCFDAIR=bluecfd_air)  # -> unZip_path; inputs unzip: Boolean, replace: Boolean
# ---------- unzip_bluecfd_air: Python ----------
# Description
ghenv.Component.Name = "AB unzip blueCFD AIR"
ghenv.Component.NickName = 'unzip blueCFD AIR'
ghenv.Component.Message = '0.1.0'
ghenv.Component.Category = 'Ant blueCFD'
ghenv.Component.SubCategory = ''

import os
import zipfile
import shutil  
import time

def mkdir(path):
    folder = os.path.exists(path)
    if not folder:
        os.makedirs(path)
def uniquify(path):
    filename, extension = os.path.splitext(path)
    counter = 1
    while os.path.exists(path):
        path = filename.split("(")[0]+ "(" + str(counter) + ")" + extension
        counter += 1
    return path
    
def get_lastest_folder(blueCFDAIR):
    folder, extension = os.path.splitext(blueCFDAIR)

    father_folder = os.path.join(os.path.abspath(os.path.join(blueCFDAIR,"..")))
    
    ctime_1 = time.time()-10000000
    path = False
    for filename in os.listdir(father_folder):
        if filename.split("(")[0] in folder:
            new_path = folder.replace(folder.split("\\")[-1],filename)
            ctime = os.path.getmtime(new_path)

            if ctime>ctime_1:
                path = new_path
                ctime_1=ctime
    return path

if blueCFDAIR:
    file_name = blueCFDAIR.split("\\")[-1].split(".")[0]

    if _folder is None:
        unZip_path = get_lastest_folder(blueCFDAIR)
        print unZip_path
        if unZip_path is False:
            unZip_path = os.path.join(os.path.abspath(os.path.join(blueCFDAIR,"..")),file_name)
    else:
        unZip_path = os.path.join(_folder,file_name)


if unzip and unZip_path:
    if replace is not True:
        unZip_path = uniquify(unZip_path) 
        
    try:
        shutil.rmtree(unZip_path) 
    except:
        mkdir(unZip_path)
    f = zipfile.ZipFile( blueCFDAIR,'r')
    for file in f.namelist():
        f.extract(file, unZip_path)
# ---------- end unzip_bluecfd_air ----------
